# Grasshopper definition MocapDemo-garthz.gh (Grasshopper 0.9.76)
# plug-ins: Python Interpreter

# ----
# Mocap Stream Receiver
# Construct coordinate axes for each object
# from the origin point and  unit basis vectors.
# 
# Note that these have been rotated from
# Optitrack XZ ground plane conventions to
# Rhino XY ground plane conventions.
timer = Timer(TimerInterval=20, Target=python)
python = PythonScript(reset=Toggle(False), version="2900")  # -> out, received, position, orient, xaxis, yaxis; inputs reset: Boolean
# ---------- python: Python ----------
# demo_receiver.py - the motion capture script in the ghpython object in MocapDemo.gh
#
# Demonstration of receiving and parsing an Optitrack motion capture real-time stream.
# This is normally polled from a timer.
#
# inputs
#   reset   - Boolean flag to reset the receiver system
#   version - string defining the protocol version number (e.g. "2900" for Motive 1.9)
#
# outputs
#   out      - debugging text stream
#   received - flag true if new data was received
#   position - data tree of position tuples
#   orient   - data tree of quaternion tuples, orientations are (x,y,z,w) quaternions
#   xaxis    - data tree of X axis unit vectors (computed from orientations)
#   yaxis    - data tree of Y axis unit vectors (computed from orientations)

# use persistent state context
import scriptcontext

# import the Optitrack stream receiver
import optirecv

# If the user reset input is set, then clear any existing state and do nothing.
if reset:
    print "Resetting receiver state."
    scriptcontext.sticky['mocap_port'] = None
 
else:
   # fetch or create the persistent motion capture streaming receiver port
    port = scriptcontext.sticky.get('mocap_port')
    if port is None:
        port = optirecv.OptitrackReceiver(version)
        scriptcontext.sticky['mocap_port'] = port
    
    received = True
    while received:
        received = port.poll()
        
    # always set the output variables so the most recent values are available
    position, orient, xaxis, yaxis = port.make_data_trees()
# ---------- end python ----------
panel = Panel(python.out)
panel_2 = Panel(python.received)
pt = Point(python.yaxis)
pt_2 = Point(python.xaxis)
pt_3 = Point(python.position)
bool = Boolean(python.received)
panel_3 = Panel(python.position)
addition = Addition(A=pt_3, B=pt_2)
addition_2 = Addition(A=pt_3, B=pt)
ln = Line(StartPoint=pt_3, EndPoint=addition)
ln_2 = Line(StartPoint=pt_3, EndPoint=addition_2)

stride = Slider(4, range=1..20)

# ----
# Mocap CSV File Loader
# Note: the Mocap CSV loader rotates
# the input data from the XZ ground plane
# convention of the Optitrack system
# to a XY Rhino ground plane convention.
path = FilePath("C:\Users\garthz\Rhino\HMV-S16\MocapDemo\Take 2016-01-19 12.25.04 AM.csv")
panel_4 = Panel(path)
csv_loader = PythonScript(path=panel_4, stride=stride)  # -> out, names, planes
# ---------- csv_loader: Python ----------
# demo_reader.py - the file loader script in the ghpython object in MocapDemo.gh.

# Demonstration of parsing an Optitrack motion capture CSV file.
#
# inputs
#   path    - string with the full path to the CSV file
#   stride  - the sequence interval between successive points; 1 returns all points, >1 subsamples
#
# outputs
#   out      - debugging text stream
#   names    - data tree of body names
#   position - data tree of position tuples
#   xaxis    - data tree of X axis unit vectors (computed from orientations)
#   yaxis    - data tree of Y axis unit vectors (computed from orientations)


# import the Optitrack file loader from the same folder
import optiload

# load the file
take = optiload.load_csv_file(path)

print "Found rigid bodies:", take.rigid_bodies.keys()

# emit all return values
names = take.rigid_bodies.keys()
planes = optiload.all_Planes(take, int(stride))
# ---------- end csv_loader ----------
panel_5 = Panel(csv_loader.out)
panel_6 = Panel(csv_loader.names)
pln = Plane(csv_loader.planes)
panel_7 = Panel(csv_loader.planes)
viewer = ParamViewer(csv_loader.planes)
viewer_2 = ParamViewer(csv_loader.planes)

viewer_3 = ParamViewer(csv_loader.names)
xy = XYPlane(Origin=Point(0, 0, 0))

rigid_body = Slider(0, range=0..4)
merge = Merge(Data1="0", Data2=rigid_body)
path_2 = ConstructPath(Indices=merge)
branch = TreeBranch(Tree=pln, Path=path_2, MaintainPaths=True)
pt_4 = Point([Point(0, 0.1, 0), Point(0, 0, 0), Point(0.1, 0, 0)])
pline = PolyLine(Vertices=pt_4, Closed=False)
orient = Orient(Geometry=pline, Source=xy, Target=branch)  # -> Geometry, Transform

rewind_playback = Button()
enable_playback = BooleanToggle(True)
lng = ListLength(List=branch)
timer_2 = Timer(TimerInterval=20, Target=counter)
counter = PythonScript(name="playback_counter", enable=enable_playback, reset=rewind_playback, low=0, high=lng, step=1)  # -> out, value; inputs enable: Boolean, reset: Boolean, low: Int32, high: Int32, step: Int32
# ---------- counter: Python ----------
# demo_counter.py
# inputs
#  name   - counter name token string
#  enable - bool to enable counting
#  reset  - bool to reset to lowest value
#  low    - lowest output value
#  high   - upper bound on output value
#  step   - interval to step

# outputs
#   value - integer count value

import scriptcontext as sc

value = sc.sticky.get(name)

if value is None or reset or value >= high:
    value = low

elif enable:
    value = value + step

sc.sticky[name] = value
print value
# ---------- end counter ----------
panel_8 = Panel(counter.value)
item = ListItem(List=branch, Index=counter.value, Wrap=True)
cone = Cone(Base=PlaneXY(0, 0, 0), Radius=0.1, Length=0.2)  # -> Cone, Tip
xy_2 = XYPlane(Origin=Point(0, 0, 0))
orient_2 = Orient(Geometry=cone.Cone, Source=xy_2, Target=item)  # -> Geometry, Transform

capture = Button()
erase = Button()
python_2 = PythonScript(input=item, capture=capture, clear=erase)  # -> out, planes; inputs input: Plane, capture: Boolean, clear: Boolean
# ---------- python_2: Python ----------
# demo_plane_recorder.py - the plane data recording script in the ghpython object in MocapDemo.gh.
#
# inputs
#  input    - single Plane object
#  capture  - Boolean indicating the object should be added to the set
#  clear    - Boolean indicating the the data set should be erased

# other ideas:
#   path       - string with the full path to the CSV file
#   selection  - currently selected set

# outputs
#   out      - debugging text stream
#   planes   - list of Plane objects

# use RhinoCommon API
import Rhino

# use persistent state context
import scriptcontext

################################################################
class PlaneRecorder(object):
    def __init__(self):
        self.planes = []
        # state for debouncing capture input
        self._last_capture_value = False
        return

    def debounced_input(self, capture):
        """Only return true on the transition from False to True."""
        value = capture and (not self._last_capture_value)
        self._last_capture_value = capture
        return value

    def add_plane(self, plane):
        self.planes.append(plane)
        return

################################################################
if clear:
    # create an empty data recorder
    recorder = PlaneRecorder()
    scriptcontext.sticky['plane_recorder'] = recorder

else:
    # fetch or create a persistent data recorder
    recorder = scriptcontext.sticky.get('plane_recorder')
    if recorder is None:
        recorder = PlaneRecorder()
        scriptcontext.sticky['plane_recorder'] = recorder

if recorder.debounced_input(capture):
    recorder.add_plane(input)

planes = recorder.planes
print "Currently holding %d planes." % len(planes)
# ---------- end python_2 ----------
pln_2 = Plane(python_2.planes)
xy_3 = XYPlane(Origin=Point(0, 0, 0))
panel_9 = Panel(python_2.out)
orient_3 = Orient(Geometry=cone.Cone, Source=xy_3, Target=pln_2)  # -> Geometry, Transform

panel_10 = Panel(pln_2)
